# Grasshopper definition airlines.gh (Grasshopper 0.9.76)
# plug-ins: Python Interpreter

path = FilePath("H:\_git\passenger-profile-simulation\pax\test\sandbox\_superceded\SFO_D3_Airplane_160628\aircraft.json")
python = PythonScript(filePath=path)  # -> out, a
# ---------- python: Python ----------
import json


file = open(filePath).read()

data = json.loads(file)


for d in data :
    if not d == '_':
        print d
        print data[d]
# ---------- end python ----------
panel = Panel(python.out)
