# Grasshopper definition packing.gh (Grasshopper 0.9.76)
# plug-ins: Python Interpreter, Human, LunchBox

path = FilePath("H:\_git\passenger-profile-simulation\pax\test\sandbox\parallel_coordinates\flights.csv")  # disabled
path_2 = FilePath("H:\_git\passenger-profile-simulation\pax\test\sandbox\parallel_coordinates\flights.csv")  # disabled
path_3 = FilePath("H:\_git\passenger-profile-simulation\pax\test\sandbox\parallel_coordinates\flights.csv")
file = ReadFile(File=path, PerLineParse=True)  # disabled
file_2 = ReadFile(File=path_2, PerLineParse=True)  # disabled
file_3 = ReadFile(File=path_3, PerLineParse=True)
number_slider = Slider(7, range=0..10)  # disabled
number_slider_2 = Slider(7, range=0..10)  # disabled
csv = ReadCSV(CSVString=file, Delimiter=",")  # -> Headers, simplify(Values); disabled
panel = Panel(csv.Headers)  # disabled
csv_2 = ReadCSV(CSVString=file_2, Delimiter=",")  # -> Headers, simplify(Values); disabled
panel_2 = Panel(csv_2.Headers)  # disabled
csv_3 = ReadCSV(CSVString=file_3, Delimiter=",")  # -> Headers, simplify(Values)
panel_3 = Panel(csv_3.Headers)
path_4 = ConstructPath(Indices=number_slider)  # disabled
path_5 = ConstructPath(Indices=number_slider_2)  # disabled
path_6 = ConstructPath(Indices=Slider(7, range=0..10))
branch = TreeBranch(Tree=csv.Values, Path=path_4, MaintainPaths=True)  # disabled
branch_2 = TreeBranch(Tree=csv_2.Values, Path=path_5, MaintainPaths=True)  # disabled
branch_3 = TreeBranch(Tree=csv_3.Values, Path=path_6, MaintainPaths=True)
python = PythonScript(x=branch)  # -> out, a; inputs x: list; disabled
# ---------- python: Python ----------
a = [i for i in set(x) if i != 'null']
# ---------- end python ----------
python_2 = PythonScript(x=branch_2)  # -> out, a; inputs x: list; disabled; same code as python
panel_4 = Panel("a")  # disabled
python_3 = PythonScript(x=branch_3)  # -> out, a; inputs x: list; same code as python
panel_5 = Panel("a")  # disabled
number_slider_3 = Slider(2, range=0..10)  # disabled
number_slider_4 = Slider(2, range=0..10)  # disabled
panel_6 = Panel("1")  # disabled
panel_7 = Panel("1")  # disabled
flip = FlipMatrix(Data=csv.Values)  # disabled
flip_2 = FlipMatrix(Data=csv_2.Values)  # disabled
fragment = TextFragment(Text=python.a, Start=panel_6)  # disabled
flip_3 = FlipMatrix(Data=csv_3.Values)
panel_8 = Panel("b")  # disabled
fragment_2 = TextFragment(Text=python_2.a, Start=panel_7)  # disabled
panel_9 = Panel("7")  # disabled
panel_10 = Panel("b")  # disabled
fragment_3 = TextFragment(Text=python_3.a, Start="1")
panel_11 = Panel("7")  # disabled
number_slider_5 = Slider(2, range=0..10)  # disabled
number_slider_6 = Slider(2, range=0..10)  # disabled
number_slider_7 = Slider(0, range=0..100)  # disabled
number_slider_8 = Slider(9, range=0..10)  # disabled
number_slider_9 = Slider(8, range=0..10)  # disabled
number_slider_10 = Slider(1, range=0..1)  # disabled
number_slider_11 = Slider(9, range=0..10)  # disabled
number_slider_12 = Slider(8, range=0..10)  # disabled
rep = ReplaceText(Text=fragment, Find=panel_4, RecursiveReplace=False)  # disabled
rep_2 = ReplaceText(Text=fragment_2, Find=panel_5, RecursiveReplace=False)  # disabled
rep_3 = ReplaceText(Text=fragment_3, Find="a", RecursiveReplace=False)
rep_4 = ReplaceText(Text=rep, Find=panel_8, RecursiveReplace=False)  # disabled
rep_5 = ReplaceText(Text=rep_2, Find=panel_10, RecursiveReplace=False)  # disabled
rep_6 = ReplaceText(Text=rep_3, Find="b", RecursiveReplace=False)
number_slider_13 = Slider(585, range=0..1000)  # disabled
number_slider_14 = Slider(585, range=0..1000)
item = ListItem(List=flip, Index=panel_9, Wrap=True)  # disabled
item_2 = ListItem(List=flip_2, Index=panel_11, Wrap=True)  # disabled
num = Number(rep_4)  # disabled
item_3 = ListItem(List=flip_3, Index="7", Wrap=True)
num_2 = Number(rep_5)  # disabled
panel_12 = Panel(rep_6)
num_3 = Number(rep_6)
item_4 = ListItem(List=flip_2, Index=number_slider_10, Wrap=True)  # disabled
item_5 = ListItem(List=flip_2, Index=number_slider_7, Wrap=True)  # disabled
item_6 = ListItem(List=flip, Index=number_slider_3, Wrap=True)  # -> flatten(Item); disabled
item_7 = ListItem(List=flip_3, Index=Slider(1, range=0..1), Wrap=True)
item_8 = ListItem(List=flip_3, Index=Slider(0, range=0..100), Wrap=True)
item_9 = ListItem(List=flip_2, Index=number_slider_4, Wrap=True)  # -> flatten(Item); disabled
item_10 = ListItem(List=flip_3, Index=Slider(2, range=0..10), Wrap=True)  # -> flatten(Item)
number_slider_15 = Slider(7, range=0..10)  # disabled
number_slider_16 = Slider(3, range=0..10)  # disabled
number_slider_17 = Slider(3, range=0..10)
sort = SortList(Keys=num, ValuesA=python.a)  # -> Keys, ValuesA; disabled
sort_2 = SortList(Keys=num_2, ValuesA=python_2.a)  # -> Keys, ValuesA; disabled
item_11 = ListItem(List=flip, Index=number_slider_5, Wrap=True)  # disabled
python_4 = PythonScript(x=item_6)  # -> out, a; inputs x: list; disabled; same code as python
panel_13 = Panel("1440")  # disabled
sort_3 = SortList(Keys=num_3, ValuesA=python_3.a)  # -> Keys, ValuesA
panel_14 = Panel(",")  # disabled
item_12 = ListItem(List=flip_2, Index=number_slider_6, Wrap=True)  # disabled
python_5 = PythonScript(x=item_9)  # -> out, a; inputs x: list; disabled; same code as python
item_13 = ListItem(List=flip_3, Index=Slider(2, range=0..10), Wrap=True)
python_6 = PythonScript(x=item_10)  # -> out, a; inputs x: list; same code as python
number_slider_18 = Slider(144, range=0..1000)  # disabled
mindex = MemberIndex(Set=sort.ValuesA, Member=item)  # -> Index, Count; disabled
mindex_2 = MemberIndex(Set=sort_2.ValuesA, Member=item_2)  # -> Index, Count; disabled
item_14 = ListItem(List=flip, Index=number_slider_8, Wrap=True)  # disabled
mindex_3 = MemberIndex(Set=sort_3.ValuesA, Member=item_3)  # -> Index, Count
item_15 = ListItem(List=flip, Index=number_slider_9, Wrap=True)  # disabled
item_16 = ListItem(List=flip_2, Index=number_slider_11, Wrap=True)  # disabled
item_17 = ListItem(List=flip_2, Index=number_slider_12, Wrap=True)  # disabled
item_18 = ListItem(List=flip_3, Index=Slider(9, range=0..10), Wrap=True)
item_19 = ListItem(List=flip_3, Index=Slider(8, range=0..10), Wrap=True)
lng = ListLength(List=sort.ValuesA)  # disabled
lng_2 = ListLength(List=sort_2.ValuesA)  # disabled
lng_3 = ListLength(List=sort_3.ValuesA)
lng_4 = ListLength(List=python_4.a)  # disabled
lng_5 = ListLength(List=python_5.a)  # disabled
lng_6 = ListLength(List=python_6.a)
mindex_4 = MemberIndex(Set=python_4.a, Member=item_11)  # -> Index, Count; disabled
mindex_5 = MemberIndex(Set=python_5.a, Member=item_12)  # -> Index, Count; disabled
mindex_6 = MemberIndex(Set=python_6.a, Member=item_13)  # -> Index, Count
join = TextJoin(Text=[item_5, item_4], Join=panel_14)  # disabled
join_2 = TextJoin(Text=[item_8, item_7], Join=",")
one_over_x = OneOverX(Value=panel_13)  # disabled
range = Range(Domain=Domain(0, 1), Steps=lng_4)  # disabled
series = Series(Start=0, Step=number_slider_15, Count=lng)  # disabled
one_over_x_2 = OneOverX(Value="1440")
range_2 = Range(Domain=Domain(0, 1), Steps=lng_5)  # disabled
series_2 = Series(Start=0, Step=number_slider_16, Count=lng_2)  # disabled
number_slider_19 = Slider(1000, range=0..1000)  # disabled
range_3 = Range(Domain=Domain(0, 1), Steps=lng_6)
series_3 = Series(Start=0, Step=number_slider_17, Count=lng_3)
number_slider_20 = Slider(1000, range=0..1000)  # disabled
subtraction = Subtraction(A=item_15, B=item_14)  # disabled
number_slider_21 = Slider(39, range=0..10000)
number_slider_22 = Slider(1000, range=0..1000)
number_slider_23 = Slider(4, range=0..100)  # disabled
subtraction_2 = Subtraction(A=item_17, B=item_16)  # disabled
multiplication = Multiplication(A=item_14, B=number_slider_18)  # disabled
number_slider_24 = Slider(2, range=0..100)  # disabled
subtraction_3 = Subtraction(A=item_19, B=item_18)
multiplication_2 = Multiplication(A=item_16, B=number_slider_13)  # disabled
multiplication_3 = Multiplication(A=mindex.Index, B=number_slider_15)  # disabled
multiplication_4 = Multiplication(A=item_15, B=number_slider_18)  # disabled
multiplication_5 = Multiplication(A=item_18, B=number_slider_14)
multiplication_6 = Multiplication(A=mindex_2.Index, B=number_slider_16)  # disabled
multiplication_7 = Multiplication(A=item_17, B=number_slider_13)  # disabled
multiplication_8 = Multiplication(A=mindex_3.Index, B=number_slider_17)
multiplication_9 = Multiplication(A=item_19, B=number_slider_14)
multiplication_10 = Multiplication(A=number_slider_13, B=one_over_x)  # disabled
split = TextSplit(Text=join_2, Separators="\"")
multiplication_11 = Multiplication(A=number_slider_14, B=one_over_x_2)
panel_15 = Panel(join)  # disabled
number_slider_25 = Slider(146, range=0..1000)  # disabled
item_20 = ListItem(List=range, Index=mindex_4.Index, Wrap=True)  # disabled
number_slider_26 = Slider(146, range=0..1000)  # disabled
item_21 = ListItem(List=range_3, Index=mindex_6.Index, Wrap=True)
item_22 = ListItem(List=range_2, Index=mindex_5.Index, Wrap=True)  # disabled
number_slider_27 = Slider(146, range=0..1000)
neg = Negative(Value=number_slider_23)  # disabled
item_23 = ListItem(List=split, Index=Slider(1, range=0..1), Wrap=True)
pt = ConstructPoint(XCoordinate=neg, YCoordinate=0, ZCoordinate=0)  # disabled
neg_2 = Negative(Value=number_slider_24)  # disabled
pt_2 = ConstructPoint(XCoordinate=neg_2, YCoordinate=0, ZCoordinate=0)  # disabled
panel_16 = Panel(split)
neg_3 = Negative(Value=Slider(2, range=0..100))
multiplication_12 = Multiplication(A=subtraction, B=number_slider_19)  # disabled
series_4 = Series(Start=0, Step=multiplication_10, Count=panel_13)  # disabled
mindex_7 = MemberIndex(Set=flatten(item_13), Member=python_6.a)  # -> Index, Count
pt_3 = ConstructPoint(XCoordinate=neg_3, YCoordinate=0, ZCoordinate=0)
multiplication_13 = Multiplication(A=subtraction_2, B=number_slider_20)  # disabled
series_5 = Series(Start=0, Step=multiplication_11, Count="1440")
multiplication_14 = Multiplication(A=subtraction_3, B=Slider(2, range=0..100))
panel_17 = Panel(item_20)  # disabled
Y = UnitY(Factor=neg)  # disabled
one_over_x_3 = OneOverX(Value=Slider(10, range=0..10))
pt_4 = ConstructPoint(XCoordinate=multiplication_3, YCoordinate=multiplication, ZCoordinate=0)  # disabled
pt_5 = ConstructPoint(XCoordinate=multiplication_5, YCoordinate=multiplication_8, ZCoordinate=0)
pt_6 = ConstructPoint(XCoordinate=multiplication_2, YCoordinate=multiplication_6, ZCoordinate=0)  # disabled
number_slider_28 = Slider(1.5, range=0..10)  # disabled
X = UnitX(Factor=neg_2)  # disabled
pt_7 = ConstructPoint(XCoordinate=series, YCoordinate=0, ZCoordinate=0)  # disabled
item_24 = ListItem(List=reverse(series_5), Index=0, Wrap=True)
number_slider_29 = Slider(2.4, range=0..10)  # disabled
X_2 = UnitX(Factor=neg_3)
ln = NaturalLogarithm(Value=multiplication_12)  # disabled
pt_8 = ConstructPoint(XCoordinate=0, YCoordinate=series_2, ZCoordinate=0)  # disabled
pt_9 = ConstructPoint(XCoordinate=multiplication_3, YCoordinate=multiplication_4, ZCoordinate=0)  # disabled
ln_2 = NaturalLogarithm(Value=multiplication_13)  # disabled
pt_10 = ConstructPoint(XCoordinate=0, YCoordinate=series_3, ZCoordinate=0)
gradient = Gradient(
    LowerLimit=0,
    UpperLimit=1,
    Parameter=item_20,
    stops=[0: RGB(243, 57, 0), 0.1: RGB(236, 27, 60), 0.2: RGB(210, 0, 118), 0.3: RGB(103, 0, 120), 0.4: RGB(39, 72, 161), 0.5: RGB(1, 192, 229), 0.6: RGB(18, 178, 90), 0.7: RGB(79, 186, 8), 0.8: RGB(220, 237, 32), 0.9: RGB(247, 159, 20), 1: RGB(243, 57, 0)])  # disabled
number_slider_30 = Slider(2, range=0..10)  # disabled
pt_11 = ConstructPoint(XCoordinate=multiplication_7, YCoordinate=multiplication_6, ZCoordinate=0)  # disabled
number_slider_31 = Slider(1, range=0..1)  # disabled
gradient_2 = Gradient(LowerLimit=0, UpperLimit=1, Parameter=item_22, stops=[0: RGB(0, 183, 255), 1: RGB(255, 178, 0)])  # disabled
pt_12 = ConstructPoint(XCoordinate=multiplication_9, YCoordinate=multiplication_8, ZCoordinate=0)
pt_13 = ConstructPoint(XCoordinate=series_4, YCoordinate=0, ZCoordinate=0)  # disabled
number_slider_32 = Slider(1, range=0..1)
Y_2 = UnitY(Factor=1)  # disabled
gradient_3 = Gradient(LowerLimit=0, UpperLimit=1, Parameter=item_21, stops=[0: RGB(0, 183, 255), 1: RGB(255, 178, 0)])
pt_14 = ConstructPoint(XCoordinate=series_5, YCoordinate=0, ZCoordinate=0)
sqrt = SquareRoot(Value=multiplication_14)
pow = Power(A=multiplication_14, B=one_over_x_3)
number_slider_33 = Slider(1.05, range=0..10)  # disabled
move = Move(Geometry=pt_7, Motion=Y)  # -> Geometry, Transform; disabled
move_2 = Move(Geometry=pt_8, Motion=X)  # -> Geometry, Transform; disabled
move_3 = Move(Geometry=pt_10, Motion=X_2)  # -> Geometry, Transform
swatch = ColourSwatch(SwatchColor=RGB(0, 0, 0))  # disabled
number_slider_34 = Slider(0, range=0..100)
number_slider_35 = Slider(10, range=0..10)  # disabled
number_slider_36 = Slider(10, range=0..10)
X_3 = UnitX(Factor=1)  # disabled
number_slider_37 = Slider(30, range=0..100)  # disabled
X_4 = UnitX(Factor=1)
ln_3 = Line(StartPoint=pt_4, EndPoint=pt_9)  # disabled
ln_4 = Line(StartPoint=pt_6, EndPoint=pt_11)  # disabled
pline = PolyLine(Vertices=pt_7, Closed=False)  # disabled
pline_2 = PolyLine(Vertices=pt_10, Closed=False)
pline_3 = PolyLine(Vertices=pt_8, Closed=False)  # disabled
number_slider_38 = Slider(5, range=0..10)  # disabled
number_slider_39 = Slider(5, range=0..10)
ln_5 = Line(StartPoint=pt_5, EndPoint=pt_12)
number_slider_40 = Slider(3, range=0..10)  # disabled
swatch_2 = ColourSwatch(SwatchColor=RGB(0, 0, 0))  # disabled
number_slider_41 = Slider(3, range=0..10)  # disabled
number_slider_42 = Slider(0.5, range=0..1)  # disabled
swatch_3 = ColourSwatch(SwatchColor=RGB(0, 0, 0))  # disabled
number_slider_43 = Slider(3, range=0..10)
number_slider_44 = Slider(0.5, range=0..1)  # disabled
Y_3 = UnitY(Factor=1)  # disabled
swatch_4 = ColourSwatch(SwatchColor=RGB(0, 0, 0))
Y_4 = UnitY(Factor=1)
ahsv = SplitAHSV(Colour=gradient)  # -> Alpha, Hue, Saturation, Value; disabled
panel_18 = Panel(pt_9)  # disabled
ahsv_2 = SplitAHSV(Colour=gradient_2)  # -> Alpha, Hue, Saturation, Value; disabled
neg_4 = Negative(Value=pow)
panel_19 = Panel(pt_11)  # disabled
line = LineSDL(Start=pt, Direction=Y_2, Length=number_slider_25)  # disabled
ahsv_3 = SplitAHSV(Colour=gradient_3)  # -> Alpha, Hue, Saturation, Value
len = Length(Curve=pline_3)  # disabled
len_2 = Length(Curve=pline_2)
tag = TextTag3D(Location=move.Geometry, Text=sort.ValuesA, Size=number_slider_28, Colour=swatch_2, Justification=7)  # disabled
line_2 = LineSDL(Start=pt_2, Direction=X_3, Length=number_slider_26)  # disabled
series_6 = Series(Start=0, Step=1, Count=number_slider_37)  # disabled
tag_2 = TextTag3D(Location=move_2.Geometry, Text=sort_2.ValuesA, Size=number_slider_29, Colour=swatch_3, Justification=9)  # disabled
tag_3 = TextTag3D(Location=pt_6, Text=join, Size=number_slider_33, Colour=swatch, Justification=7)  # disabled
Y_5 = UnitY(Factor=pow)
series_7 = Series(Start=0, Step=1, Count=Slider(30, range=0..100))
justified_text = JustifiedText3d(
    Location=pt_5,
    Text=item_23,
    Size=Slider(1.19, range=0..10),
    Color=ColourSwatch(SwatchColor=RGB(0, 0, 0)),
    HorizontalAlignment=number_slider_34,
    VerticalAlginment=number_slider_34,
    UseMeshes=False,
    Bake=Toggle(False))
line_3 = LineSDL(Start=pt_10, Direction=X_4, Length=item_24)
swatch_5 = ColourSwatch(SwatchColor=RGB(0, 0, 0))  # disabled
line_4 = LineSDL(Start=pt_13, Direction=Y_3, Length=len)  # disabled
line_5 = LineSDL(Start=pt_14, Direction=Y_4, Length=len_2)
bool = Boolean(series_6)  # disabled
preview = CustomPreview(Geometry=[pline, line], Shader=swatch_2)  # disabled
bool_2 = Boolean(series_7)
preview_2 = CustomPreview(Geometry=[pline_3, line_2], Shader=swatch_3)  # disabled
justified_text_2 = JustifiedText3d(
    Location=move_3.Geometry,
    Text=sort_3.ValuesA,
    Size=Slider(2.2, range=0..10),
    Color=swatch_4,
    HorizontalAlignment=Slider(2, range=0..100),
    VerticalAlginment=1,
    UseMeshes=False,
    Bake=Toggle(False))
offset = Offset(Curve=ln_5, Distance=[pow, neg_4], Plane=PlaneXY(0, 0, 0), Corners=1)
not = GateNot(A=bool)  # disabled
not_2 = GateNot(A=bool_2)
hsl = ColourHSL(Alpha=ahsv.Alpha, Hue=ahsv.Hue, Saturation=number_slider_42, Luminance=0.5)  # disabled
hsl_2 = ColourHSL(Alpha=ahsv_3.Alpha, Hue=ahsv_3.Hue, Saturation=Slider(0.5, range=0..1), Luminance=0.5)
hsl_3 = ColourHSL(Alpha=ahsv_2.Alpha, Hue=ahsv_2.Hue, Saturation=number_slider_44, Luminance=0.5)  # disabled
trim = TrimTree(Tree=offset, Depth=1)
cull = CullPattern(List=line_4, CullPattern=not)  # disabled
cull_2 = CullPattern(List=line_5, CullPattern=not_2)
preview_3 = CustomPreview(Geometry=[pline_2, line_3], Shader=swatch_4)
loft = Loft(Curves=trim, Options={Adjust=False, Closed=False, LoftEnds=0, LoftSimp=0, LoftType=0, Rebuild=10, Refit=0.01})
previewlw = CustomPreviewLineweights(Geometry=ln_3, Shader=hsl, Thickness=ln, Absolute=False)  # disabled
previewlw_2 = CustomPreviewLineweights(Geometry=ln_4, Shader=hsl_3, Thickness=ln_2, Absolute=False)  # disabled
panel_20 = Panel(mindex_7.Index)
edges = BrepEdges(Brep=loft)  # -> Naked, Interior, NonManifold
preview_4 = CustomPreview(Geometry=cull_2, Shader=ColourSwatch(SwatchColor=RGB(0, 0, 0)))
panel_21 = Panel(trim)
preview_5 = CustomPreview(Geometry=cull, Shader=swatch_5)  # disabled
item_25 = ListItem(List=flatten(pt_5), Index=mindex_7.Index, Wrap=True)  # -> simplify(Item)
createatts = CreateAttributes(LayerName="flights", Color=hsl_2, enableFullPath=False)
join_3 = JoinCurves(Curves=edges.Naked, Preserve=False)
previewlw_3 = CustomPreviewLineweights(Geometry=loft, Shader=hsl_2, Absolute=False)
bake = BakeGeometry(Bake=Toggle(False), Geometry=join_3, Attributes=createatts, DeleteOldBakes=False, PreserveTrees=False)
panel_22 = Panel(item_25)
path_7 = ConstructPath(Indices=Slider(6, range=0..10))
branch_4 = TreeBranch(Tree=item_25, Path=path_7, MaintainPaths=True)
prox = Proximity2D(Points=branch_4, Plane=PlaneXY(0, 0, 0), Group=Slider(10, range=0..100))  # -> Links, Topology; disabled
