# Grasshopper definition viz.gh (Grasshopper 0.9.76)
# plug-ins: Human, LunchBox

path = FilePath("H:\_git\passenger-profile-simulation\pax\test\sandbox\160627\passengers.csv")
file = ReadFile(File=path, PerLineParse=True)
csv = ReadCSV(CSVString=file, Delimiter=",")  # -> Headers, Values
flip = FlipMatrix(Data=csv.Values)
item = ListItem(List=flip, Index=Slider(1, range=0..1), Wrap=True)
tmatch = MatchText(Text=item, RegEx="transfer", Case=True)
not = GateNot(A=tmatch)
cull = CullPattern(List=flip, CullPattern=not)

series = Series(Start=Slider(0, range=0..10), Step=1, Count=Slider(5, range=0..10))
item_2 = ListItem(List=cull, Index=series, Wrap=True)

series_2 = Series(Start=Slider(5, range=0..10), Step=1, Count=Slider(6, range=0..10))
item_3 = ListItem(List=cull, Index=series_2, Wrap=True)

panel = Panel(item_2)
number_slider = Slider(5, range=0..10)
multiplication = Multiplication(A=item_3, B=1440)
division = Division(A=multiplication, B=number_slider)
round = Round(Number=division)  # -> Nearest, Floor, Ceiling
multiplication_2 = Multiplication(A=round.Nearest, B=number_slider)
data = Data(multiplication_2)
lng = ListLength(List=data)

division_2 = Division(A="2*pi", B="1440")
multiplication_3 = Multiplication(A=division_2, B=data)

number_slider_2 = Slider(10, range=0..10)
series_3 = Series(Start=Slider(50, range=0..100), Step=number_slider_2, Count=lng)  # -> simplify(Series)
item_4 = ListItem(List=item_2, Index=Slider(1, range=0..1), Wrap=True)

panel_2 = Panel("""arrival
security
departure lounge
gate
boarding
departure""")
branch = TreeBranch(Tree=series_3, Path="{0}", MaintainPaths=True)
subtraction = Subtraction(A=branch, B=Slider(3, range=0..100))
pt = ConstructPoint(XCoordinate=0, YCoordinate=subtraction, ZCoordinate=0)
justified_text = JustifiedText3d(
    Location=pt,
    Text=panel_2,
    Size=Slider(2, range=0..10),
    Color=ColourSwatch(SwatchColor=RGB(255, 255, 255)),
    HorizontalAlignment=Slider(0, range=0..100),
    VerticalAlginment=1,
    UseMeshes=False,
    Bake=False)

tmatch_2 = MatchText(Text=item_4, RegEx="international", Case=True)

tmatch_3 = MatchText(Text=item_4, RegEx="domestic", Case=True)

pt_2 = PointPolar(BasePlane=PlaneXY(0, 0, 0), XYAngle=expr("-x + pi/2", multiplication_3), ZAngle=0, Offset=series_3)  # -> simplify(Point)

multiplication_4 = Multiplication(A=series_3, B="2*pi")
division_3 = Division(A=multiplication_4, B="1440")
multiplication_5 = Multiplication(A=division_3, B="5")
flip_2 = FlipMatrix(Data=multiplication_5)
item_5 = ListItem(List=flip_2, Index=0, Wrap=True)
dom = ConstructDomain(DomainStart=0, DomainEnd=item_5)

dispatch = Dispatch(List=pt_2, DispatchPattern=tmatch_2)  # -> ListA, ListB
pt_3 = ConstructPoint(XCoordinate=0, YCoordinate=0, ZCoordinate=0)
flip_3 = FlipMatrix(Data=dispatch.ListA)
geo = Geometry(flip_3)
cullpt = CullDuplicates(Points=geo, Tolerance=0.1, CullMode=3)  # -> Points, Indices, Valence
dom_2 = ConstructDomain(DomainStart=0, DomainEnd=expr("-x", number_slider_2))
vec2pt = Vector2Pt(PointA=pt_3, PointB=cullpt.Points, Unitize=False)  # -> Vector, Length
pl = ConstructPlane(Origin=cullpt.Points, XAxis=vec2pt.Vector, YAxis=Vector(0, 1, 0))

dispatch_2 = Dispatch(List=pt_2, DispatchPattern=tmatch_3)  # -> ListA, ListB
pt_4 = ConstructPoint(XCoordinate=0, YCoordinate=0, ZCoordinate=0)
flip_4 = FlipMatrix(Data=dispatch_2.ListA)
geo_2 = Geometry(flip_4)
cullpt_2 = CullDuplicates(Points=geo_2, Tolerance=0.1, CullMode=3)  # -> Points, Indices, Valence
dom_3 = ConstructDomain(DomainStart=0, DomainEnd=expr("x", number_slider_2))
vec2pt_2 = Vector2Pt(PointA=pt_4, PointB=cullpt_2.Points, Unitize=False)  # -> Vector, Length
pl_2 = ConstructPlane(Origin=cullpt_2.Points, XAxis=vec2pt_2.Vector, YAxis=Vector(0, 1, 0))

merge = Merge(Data1=flip_4, Data2=flip_3)

pt_5 = ConstructPoint(XCoordinate=0, YCoordinate=0, ZCoordinate=0)
merge_2 = Merge(Data1=dispatch_2.ListA)
vec2pt_3 = Vector2Pt(PointA=pt_5, PointB=merge_2, Unitize=False)  # -> Vector, Length
amp = Amplitude(Vector=vec2pt_3.Vector, Amplitude=Slider(0.05, range=0..0.1))
series_4 = Series(Start=Slider(1688, range=0..10000), Step=1, Count=Slider(732, range=0..10000))
tancurve = TangentCurve(Vertices=merge_2, Tangents=amp, Blend=Slider(0.1, range=0..1), Degree=3)  # -> flatten(Curve), Length, Domain
clean = CleanTree(RemoveNulls=True, RemoveInvalid=True, RemoveEmpty=False, Tree=tancurve.Curve)
item_6 = ListItem(List=clean, Index=series_4, Wrap=True)
len = Length(Curve=item_6)
bnd = Bounds(Numbers=len)
dedomain = DeconstructDomain(Domain=bnd)  # -> Start, End
gradient = Gradient(LowerLimit=dedomain.Start, UpperLimit=dedomain.End, Parameter=len, stops=[0: RGB(0, 183, 255), 1: RGB(0, 17, 255)])
preview = CustomPreview(Geometry=item_6, Shader=gradient)

cullpt_3 = CullDuplicates(Points=merge, Tolerance=0.1, CullMode=3)  # -> Points, Indices, Valence

bnd_2 = Bounds(Numbers=cullpt_3.Valence)
remap = RemapNumbers(Value=cullpt.Valence, Source=bnd_2, Target=dom_2)  # -> Mapped, Clipped
amp_2 = Amplitude(Vector=vec2pt.Vector, Amplitude=remap.Mapped)
move = Move(Geometry=pl, Motion=amp_2)  # -> Geometry, Transform
rectangle = Rectangle(Plane=pl, XSize=remap.Mapped, YSize=dom, Radius=0)  # -> Rectangle, Length
boundary = BoundarySurfaces(Edges=graft(rectangle.Rectangle))
preview_2 = CustomPreview(Geometry=boundary, Shader=ColourSwatch(SwatchColor=RGBA(255, 162, 0, 214)))

bnd_3 = Bounds(Numbers=cullpt_3.Valence)
remap_2 = RemapNumbers(Value=cullpt_2.Valence, Source=bnd_3, Target=dom_3)  # -> Mapped, Clipped
amp_3 = Amplitude(Vector=vec2pt_2.Vector, Amplitude=remap_2.Mapped)
move_2 = Move(Geometry=pl_2, Motion=amp_3)  # -> Geometry, Transform
rectangle_2 = Rectangle(Plane=pl_2, XSize=remap_2.Mapped, YSize=dom, Radius=0)  # -> Rectangle, Length
boundary_2 = BoundarySurfaces(Edges=graft(rectangle_2.Rectangle))
preview_3 = CustomPreview(Geometry=boundary_2, Shader=ColourSwatch(SwatchColor=RGBA(0, 166, 255, 62)))

pt_6 = ConstructPoint(XCoordinate=0, YCoordinate=0, ZCoordinate=0)
merge_3 = Merge(Data1=dispatch.ListA)
vec2pt_4 = Vector2Pt(PointA=pt_6, PointB=merge_3, Unitize=False)  # -> Vector, Length
amp_4 = Amplitude(Vector=vec2pt_4.Vector, Amplitude=Slider(0.05, range=0..0.1))
series_5 = Series(Start=Slider(3699, range=0..10000), Step=1, Count=Slider(604, range=0..10000))
tancurve_2 = TangentCurve(Vertices=merge_3, Tangents=amp_4, Blend=Slider(0.1, range=0..1), Degree=3)  # -> flatten(Curve), Length, Domain
clean_2 = CleanTree(RemoveNulls=True, RemoveInvalid=True, RemoveEmpty=False, Tree=tancurve_2.Curve)
item_7 = ListItem(List=clean_2, Index=series_5, Wrap=True)
len_2 = Length(Curve=item_7)
bnd_4 = Bounds(Numbers=len_2)
dedomain_2 = DeconstructDomain(Domain=bnd_4)  # -> Start, End

gradient_2 = Gradient(LowerLimit=dedomain_2.Start, UpperLimit=dedomain_2.End, Parameter=len_2, stops=[0: RGB(255, 178, 0), 1: RGB(255, 25, 0)])

preview_4 = CustomPreview(Geometry=item_7, Shader=gradient_2)
